# Grasshopper definition Allconfiguration.gh (Grasshopper 1.0.7)
# plug-ins: Pufferfish, karambaGH, SpaceSyntaxDesign_GH, Kangaroo2 Components, EleFront

python = GhPythonScript(
    popup=Slider(2, range=2..6),
    exarea=Slider(2, range=2..6),
    trucks=Slider(2, range=2..6),
    brickpress=Slider(12, range=12..36),
    brickStor=Slider(4, range=4..12),
    textiletread=Slider(8, range=8..24),
    textiledyeing=Slider(2, range=2..6),
    textilealag=Slider(8, range=8..24),
    textileweaving=Slider(6, range=6..18),
    potterywhee=Slider(6, range=6..18),
    potteryscup=Slider(12, range=12..36),
    potterykiln=Slider(2, range=2..6),
    potteryglaz=Slider(2, range=2..6),
    office=Slider(2, range=2..6),
    canteen=Slider(2, range=2..6))  # -> out, combined, xaxis, yaxis, num, ypoint, xpoint, area
# ---------- python: Python ----------
import math
import rhinoscriptsyntax as rs

#fixing x to 6 modules for hubs 
#this part will be deleted and replaced with sliders in ghpython

fixedx = 6

#make lists of programs based on functions
basic=[popup,exarea,trucks]
brick=[brickpress,brickStor]
textile = [textiletread,textiledyeing,textilealag,textileweaving]
pottery = [potterywhee,potteryscup,potterykiln,potteryglaz]
other = [office,canteen]

#sum up the total employee number to have total number
total = basic+brick+textile+pottery+other
sumtotal= sum(total)
print (sumtotal)

# make clip function to set minimum and maximum number of area 
def clip(lo, a, hi):
    return max(lo, min(hi,a))

class Popup() :
    def area(self):
        occupants = popup if (popup) % 2 == 0 else popup - 1 # always increase in 2
        lo = 2                                               # lowest value of number of employee
        hi = 6                                               # highest value of number of employee
        Eacharea = 36                                        # area of each rooms 
        
        b = clip(lo,occupants,hi)                            
        Tarea = b * Eacharea/2
        numB = Tarea / (lo * Eacharea/2)
        y = Eacharea / fixedx
        
        return (Tarea,Eacharea,numB,fixedx,y)

class Exarea():
    def area(self):
        occupants = exarea if (exarea) % 2 == 0 else exarea - 1
        lo = 2
        hi = 6
        Eacharea = 54
        
        b = clip(lo,occupants,hi)
        Tarea = b * Eacharea/2
        numB = Tarea / (lo*Eacharea/2)
        y = Eacharea / fixedx
        
        return (Tarea,Eacharea,numB,fixedx,y)

class Trucks():
    def area(self):
        occupants = trucks if (trucks) % 2 == 0 else trucks - 1
        lo = 2
        hi = 6
        Eacharea = 54
        
        b = clip(lo,occupants,hi)
        Tarea = b * Eacharea/2
        numB = Tarea / (lo*Eacharea/2)
        y = Eacharea / fixedx
        
        return (Tarea,Eacharea,numB,fixedx,y)

Popup = Popup()
Exarea = Exarea()
Trucks = Trucks()
Popup_area = Popup.area()
Exarea_area = Exarea.area()
Trucks_area = Trucks.area()

class Brickpress() :
    def area(self):
        occupants = brickpress if (brickpress) % 2 == 0 else brickpress - 1
        lo = 12
        hi = 36
        Eacharea = 90
        
        b = clip(lo,occupants,hi)
        Tarea = b * Eacharea/2
        numB = int(Tarea / (lo * Eacharea/2))
        Rarea = Eacharea * numB
        y = Eacharea / fixedx
        
        return (Rarea,Eacharea,numB,fixedx,y)
        

class BrickStor():
    def area(self):
        occupants = brickStor if (brickStor) % 2 == 0 else brickStor - 1
        lo = 4
        hi = 12
        Eacharea = 72
        
        b = clip(lo,occupants,hi)
        Tarea = b * Eacharea/2
        numB = int(Tarea / (lo*Eacharea/2))
        Rarea = Eacharea * numB
        y = Eacharea / fixedx
        
        return (Rarea,Eacharea,numB,fixedx,y)

Brickpress = Brickpress()
BrickStor = BrickStor()
Brickpress_area = Brickpress.area()
BrickStor_area = BrickStor.area()

class Textiletread() :
    def area(self):
        occupants = textiletread if (textiletread) % 2 == 0 else textiletread - 1
        lo = 8
        hi = 24
        Eacharea = 36
        
        b = clip(lo,occupants,hi)
        Tarea = b * Eacharea/2
        numB = int(Tarea / (lo * Eacharea/2))
        Rarea = Eacharea * numB
        y = Eacharea / fixedx
        return (Rarea,Eacharea,numB,fixedx,y)

class Textiledyeing():
    def area(self):
        occupants = textiledyeing if (textiledyeing) % 2 == 0 else textiledyeing - 1
        lo = 2
        hi = 6
        Eacharea = 18
        
        b = clip(lo,occupants,hi)
        Tarea = b * Eacharea/2
        numB = int(Tarea / (lo*Eacharea/2))
        Rarea = Eacharea * numB
        y = Eacharea / fixedx
        return (Rarea,Eacharea,numB,fixedx,y)

class Textilealag():
    def area(self):
        occupants = textilealag if (textilealag) % 2 == 0 else textilealag- 1
        lo = 8
        hi = 24
        Eacharea = 36
        
        b = clip(lo,occupants,hi)
        Tarea = b * Eacharea/2
        numB = int(Tarea / (lo*Eacharea/2))
        Rarea = Eacharea * numB
        y = Eacharea / fixedx
        return (Rarea,Eacharea,numB,fixedx,y)

class Textileweaving():
    def area(self):
        occupants = textileweaving if (textileweaving) % 2 == 0 else textileweaving- 1
        lo = 6
        hi = 18
        Eacharea = 54
        
        b = clip(lo,occupants,hi)
        Tarea = b * Eacharea/2
        numB = int(Tarea / (lo*Eacharea/2))
        Rarea = Eacharea * numB
        y = Eacharea / fixedx
        return (Rarea,Eacharea,numB,fixedx,y)

class Textilestor():
    def area(self):
        textilestor = textileweaving + textilealag + textiledyeing + textiletread
        occupants = textilestor if (textilestor) % 2 == 0 else testilestor - 1 
        lo = 24
        hi = 72
        Eacharea = 18
        
        b = clip(lo,occupants,hi)
        Tarea = b * Eacharea/2
        numB = int(Tarea / (lo*Eacharea/2))
        Rarea = Eacharea * numB
        y = Eacharea / fixedx
        return (Rarea,Eacharea,numB,fixedx,y)

Textiletread = Textiletread()
Textiledyeing = Textiledyeing()
Textilealag = Textilealag()
Textileweaving = Textileweaving()
Textilestor = Textilestor()

Textiletread_area = Textiletread.area()
Textiledyeing_area = Textiledyeing.area()
Textilealag_area = Textilealag.area()
Textileweaving_area = Textileweaving.area()
Textilestor_area = Textilestor.area()


class Potterywhee() :
    def area(self):
        occupants = potterywhee if (potterywhee) % 2 == 0 else potterywhee - 1
        lo = 6
        hi = 18
        Eacharea = 36
        
        b = clip(lo,occupants,hi)
        Tarea = b * Eacharea/2
        numB = int(Tarea / (lo * Eacharea/2))
        Rarea = Eacharea * numB
        y = Eacharea / fixedx
        return (Rarea,Eacharea,numB,fixedx,y)

class Potteryscup():
    def area(self):
        occupants = potteryscup if (potteryscup) % 2 == 0 else potteryscup - 1
        lo = 12
        hi = 36
        Eacharea = 54
        
        b = clip(lo,occupants,hi)
        Tarea = b * Eacharea/2
        numB = int(Tarea / (lo*Eacharea/2))
        Rarea = Eacharea * numB
        y = Eacharea / fixedx
        return (Rarea,Eacharea,numB,fixedx,y)

class Potterykiln():
    def area(self):
        occupants = potterykiln if (potterykiln) % 2 == 0 else potterykiln- 1
        lo = 2
        hi = 6
        Eacharea = 36
        
        b = clip(lo,occupants,hi)
        Tarea = b * Eacharea/2
        numB = int(Tarea / (lo*Eacharea/2))
        Rarea = Eacharea * numB
        y = Eacharea / fixedx
        return (Rarea,Eacharea,numB,fixedx,y)

class Portteryglaz():
    def area(self):
        occupants = potteryglaz if (potteryglaz) % 2 == 0 else potteryglaz- 1
        lo = 2
        hi = 6
        Eacharea = 18
        
        b = clip(lo,occupants,hi)
        Tarea = b * Eacharea/2
        numB = int(Tarea / (lo*Eacharea/2))
        Rarea = Eacharea * numB
        y = Eacharea / fixedx
        return (Rarea,Eacharea,numB,fixedx,y)

class Potterystor():
    def area(self):
        potterystor = potteryglaz + potterykiln+ potteryscup+ potterywhee
        occupants = potterystor if (potterystor) % 2 == 0 else potterystor - 1 
        lo = 22
        hi = 66
        Eacharea = 54
        
        b = clip(lo,occupants,hi)
        Tarea = b * Eacharea/2
        numB = int(Tarea / (lo*Eacharea/2))
        Rarea = Eacharea * numB
        y = Eacharea / fixedx
        return (Rarea,Eacharea,numB,fixedx,y)

Potterywhee = Potterywhee()
Potteryscup = Potteryscup()
Potterykiln = Potterykiln()
Potteryglaz = Portteryglaz()
Potterystor = Potterystor()

Potterywhee_area = Potterywhee.area()
Potteryscup_area = Potteryscup.area()
Potterykiln_area = Potterykiln.area()
Potteryglaz_area = Potteryglaz.area()
Potterystor_area = Potterystor.area()

toiletM = sumtotal
toiletW= sumtotal
training = sumtotal

def clip(lo, a, hi):
    return max(lo, min(hi,a))

class Office() :
    def area(self):
        occupants = office if (office) % 2 == 0 else office - 1
        lo = 2
        hi = 6
        Eacharea = 18
        
        b = clip(lo,occupants,hi)
        Tarea = b * Eacharea/2
        numB = int(Tarea / (lo * Eacharea/2))
        Rarea = Eacharea * numB
        y = Eacharea / fixedx
        return (Rarea,Eacharea,numB,fixedx,y)

class ToiletM():
    def area(self):
        occupants = toiletM if (toiletM) % 2 == 0 else toiletM - 1
        lo = 72
        hi = 216
        Eacharea = 9
        
        b = clip(lo,occupants,hi)
        Tarea = b * Eacharea/2
        numB = int(Tarea / (lo*Eacharea/2))
        Rarea = Eacharea * numB
        y = math.sqrt(Eacharea)
        return (Rarea,Eacharea,numB,y,y)
class ToiletW():
    def area(self):
        occupants = toiletW if (toiletW) % 2 == 0 else toiletW- 1
        lo = 72
        hi = 216
        Eacharea = 9
        
        b = clip(lo,occupants,hi)
        Tarea = b * Eacharea/2
        numB = int(Tarea / (lo*Eacharea/2))
        Rarea = Eacharea * numB
        y= math.sqrt(Eacharea)
        return (Rarea,Eacharea,numB,y,y)
class Training():
    def area(self):
        occupants = training if (training) % 2 == 0 else training- 1
        lo = 72
        hi = 216
        Eacharea = 54
        
        b = clip(lo,occupants,hi)
        Tarea = b * Eacharea/2
        numB = int(Tarea / (lo*Eacharea/2))
        Rarea = Eacharea * numB
        y = Eacharea / fixedx
        return (Rarea,Eacharea,numB,fixedx,y)
        

class Canteen():
    def area(self):
        occupants = canteen if (canteen) % 2 == 0 else canteen- 1
        lo = 2
        hi = 6
        Eacharea = 18
        
        b = clip(lo,occupants,hi)
        Tarea = b * Eacharea/2
        numB = int(Tarea / (lo*Eacharea/2))
        Rarea = Eacharea * numB
        y = Eacharea / fixedx
        return (Rarea,Eacharea,numB,fixedx,y)
Office = Office()
ToiletM = ToiletM()
ToiletW= ToiletW()
Training = Training()
Canteen = Canteen()

Office_area = Office.area()
Training_area = Training.area()
ToiletM_area = ToiletM.area()
ToiletW_area = ToiletW.area()
Canteen_area = Canteen.area()

courtyard = sumtotal

class Courtyard() :
    def area(self):
        courtyard = sumtotal
        occupants = courtyard if (courtyard) % 1.5 == 0 else courtyard - 1.5
        lo = 72
        hi = 216
        Eacharea = 144
        
        b = clip(lo,occupants,hi)
        Tarea = b * Eacharea
        sqrt = math.sqrt(Tarea)
        num1 = 1 
        y= (math.sqrt(sqrt))
        y = 1.5 * round(y/1.5)
        Area = y*y
        
        
        return (Area,Eacharea,num1,y,y)

Courtyard = Courtyard()
Courtyard_area = Courtyard.area()

combined = [Popup_area,Exarea_area,Trucks_area,Brickpress_area,BrickStor_area,Textiletread_area,Textiledyeing_area,Textilealag_area,Textileweaving_area,Textilestor_area,Potterywhee_area,Potteryscup_area,Potterykiln_area,Potteryglaz_area,Potterystor_area,Office_area,ToiletM_area,ToiletW_area,Training_area,Canteen_area,Courtyard_area]

yaxis=[x[3]for x in combined]
xaxis=[x[4]for x in combined]
num = [x[2]for x in combined]
area = [x[0]for x in combined]


ypoint= []
xpoint= []

for point in yaxis:
    ypoint.append(rs.AddPoint(0,int(point),0))

for point in xaxis:
    xpoint.append(rs.AddPoint(int(point),0,0))
# ---------- end python ----------
panel = Panel("""popup store
exhibition area
truck area
brick press
brick storage
textile tread
textile dyeing
textile alag
textile weaving
textile storage
pottery wheel
pottery sculpture
pottery kiln
pottery glazing
pottery storage
office
Toilet M
Toilet W
Training area
canteen
Courtyard""")
rectangle = Rectangle(Plane=PlaneXY(0, 0, 0), XSize=python.xaxis, YSize=python.yaxis, Radius=0)  # -> Rectangle, Length
number_slider = Slider(40, range=0..100)
boundary = BoundarySurfaces(Edges=rectangle.Rectangle)
pt = ConstructPoint(XCoordinate=Slider(13, range=0..100), YCoordinate=Slider(-39, range=-100..100), ZCoordinate=0)
panel_2 = Panel(python.area)
debrep = DeconstructBrep(Brep=boundary)  # -> Faces, Edges, Vertices
cir = Circle(Plane=pt, Radius=Slider(23, range=0..100))
len = Length(Curve=debrep.Edges)
sqgrid = Square(Plane=PlaneXY(0, 0, 0), Size=Slider(1.5, range=0..10), ExtentX=number_slider, ExtentY=number_slider)  # -> flatten(Cells), Points
stair_module_generating_code = GhPythonScript(
    height=Slider(4, range=4..5),
    landing=Slider(1, range=0..4),
    tread=Slider(0.3, range=0..1),
    riser=Slider(0.18, range=0.12..0.2))  # -> out, anotherpts, points; inputs landing: Int32
# ---------- stair_module_generating_code: Python ----------
import Rhino.Geometry as rg
import math
import rhinoscriptsyntax as rs
import ghpythonlib.components as gc

points=[]
anotherpts=[]

# give numbers to landings, divsion for landing, number of steps in each modules
# module size 1.5 
 
landings = landing+1
divsteps = height / landings
numsteps = math.floor(divsteps / riser)
module = 1.5


# will be the number of steps in one module
print(numsteps)


# make points on each steps and then take out the first point from a list to make two different set of pointlist
 
for i in range(int(numsteps)):
    edpoint1 = rg.Point3d(tread*i,0,riser*i)
    edpoint2 = rg.Point3d(tread*i,module,0)
    points.append(edpoint1)
    anotherpts.append(edpoint2)
points.pop(0)

a = points[-1]
b = anotherpts[-1]

if landing <= 1:
    landingstartpoint = rg.Vector3d(module,0,0)
    rs.MoveObject(a,landingstartpoint)
# ---------- end stair_module_generating_code ----------
item = ListItem(List=len, Index=Slider(0, range=0..100), Wrap=True)
item_2 = ListItem(List=len, Index=Slider(1, range=0..100), Wrap=True)
boundary_2 = BoundarySurfaces(Edges=sqgrid.Cells)
crv = Curve([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])
divide = DivideCurve(Curve=cir, Count=Slider(20, range=0..100), Kinks=False)  # -> Points, Tangents, Parameters
Y = UnitY(Factor=item_2)
X = UnitX(Factor=item)
panel_3 = Panel("""3
2
5
5
5""")
area = Area(Geometry=boundary_2)  # -> Area, flatten(Centroid)
pt_2 = Point(Point(88, -40.5, 0))
divide_2 = DivideCurve(Curve=crv, Count=Slider(100, range=0..100), Kinks=False)  # -> flatten(Points), Tangents, Parameters
box = Box2Pt(PointA=stair_module_generating_code.anotherpts, PointB=stair_module_generating_code.points, Plane=PlaneXY(0, 0, 0))
neg = Negative(Value=Y)  # -> flatten(Result)
partition = PartitionList(List=divide.Points, Size=panel_3)
findneighbors = PythonScript(testPoint=divide_2.Points, pointsList=area.Centroid)  # -> report, neighborsSorted, neighborPoints; inputs testPoint: Point3d, pointsList: list of Point3d
# ---------- findneighbors: Python ----------
import Rhino as rc
import Rhino.Geometry as rg 
import Grasshopper as gh 
import rhinoscriptsyntax as rs
import ghpythonlib.components as gc


def sortListBasedonList (referenceList, listTobeSorted):
    refAndTar = zip(referenceList, listTobeSorted)
    refAndTar.sort()
    ReferenceList_Sorted, listTobeSorted_Sorted = zip(*refAndTar)
    return listTobeSorted_Sorted

distList = []
for pt in pointsList: distList.append(testPoint.DistanceTo(pt))

pointsSorted = sortListBasedonList(distList,pointsList)


neighborPoints = pointsSorted[0:2]

# find the angles
# I use Y axis as north vector
anglesList = []
northVec = rc.Geometry.Vector3d.YAxis
basePlane = rc.Geometry.Plane(testPoint, rc.Geometry.Vector3d.ZAxis)
for pt in neighborPoints:
    testVec = rc.Geometry.Vector3d (pt - testPoint)
    anglesList.append(rc.Geometry.Vector3d.VectorAngle(northVec, testVec, basePlane))


# sort the neighbor points based on the angle
neighborsSorted = sortListBasedonList(anglesList, neighborPoints)

print(neighborsSorted)

print(sortListBasedonList)
# ---------- end findneighbors ----------
llinter = LineLineIntersectionKaramba3D(Line=crv, LimitDistance_m=0.005)  # -> IntersectionPoints, LineSubSegements
ma = MassAddition(Input=neg)  # -> Result, PartialResults
pt_3 = Point(Point(-54, 117, 0))
bang = ExplodeTree(Data=partition)  # -> Branch0, Branch1, Branch2, Branch3, Branch4
move = Move(Geometry=pt_3, Motion=ma.PartialResults)  # -> Geometry, Transform
item_3 = ListItem(List=debrep.Vertices, Index=0, Wrap=True)
pt_4 = Point(llinter.IntersectionPoints)
pt_5 = Point(flatten(bang.Branch0))
pt_6 = Point(flatten(bang.Branch2))
pt_7 = Point(flatten(pt))
pt_8 = Point(flatten(bang.Branch1))
pt_9 = Point(flatten(bang.Branch3))
pt_10 = Point(flatten(bang.Branch4))
cullpt = CullDuplicates(Points=flatten(findneighbors.neighborPoints), Tolerance=0.1, CullMode=3)  # -> Points, Indices, Valence
move2pt = MoveToPoint(Geometry=debrep.Faces, PointA=graft(item_3), PointB=graft(move.Geometry))  # -> Moved, Vector, Transform
pt_11 = Point(flatten(findneighbors.neighborsSorted))
mindex = MemberIndex(Set=area.Centroid, Member=cullpt.Points)  # -> flatten(Index), Count
difference = SetDifference(SetA=area.Centroid, SetB=pt_11)
area_2 = Area(Geometry=move2pt.Moved)  # -> Area, Centroid
arrlinear = LinearArray(Geometry=move2pt.Moved, Direction=graft(X), Count=graft(python.num))  # -> simplify(Geometry), Transform
brec = BoundingRectangle(Geometry=arrlinear.Geometry, Plane=PlaneXY(0, 0, 0), Axis=0, Slide=0, Union=True)  # -> Bounding, DimensionX, DimensionY
area_3 = Area(Geometry=flatten(brec.Bounding))  # -> Area, Centroid
tag = TextTag(Location=flatten(area_2.Centroid), Text=panel)
item_4 = ListItem(List=sqgrid.Cells, Index=mindex.Index, Wrap=True)
findneighbors_2 = PythonScript(testPoint=divide_2.Points, pointsList=difference)  # -> report, neighborsSorted, neighborPoints, pt5, pt4; inputs testPoint: Point3d, pointsList: list of Point3d
# ---------- findneighbors_2: Python ----------
import Rhino as rc
import Rhino.Geometry as rg 
import Grasshopper as gh 
import rhinoscriptsyntax as rs
import ghpythonlib.components as gc


def sortListBasedonList (referenceList, listTobeSorted):
    refAndTar = zip(referenceList, listTobeSorted)
    refAndTar.sort()
    ReferenceList_Sorted, listTobeSorted_Sorted = zip(*refAndTar)
    return listTobeSorted_Sorted


distList = []
for pt in pointsList: distList.append(testPoint.DistanceTo(pt))

pointsSorted = sortListBasedonList(distList,pointsList)

pt5 = []
pt4 = []

for i in pointsSorted:
    if i < 2:
        pt5.append(i)

for i in pointsSorted:
    if i > 2 and i < 5:
        pt4.append(i)

print pt4
neighborPoints = pointsSorted[0:2]

# find the angles
# I use Y axis as north vector
anglesList = []
northVec = rc.Geometry.Vector3d.YAxis
basePlane = rc.Geometry.Plane(testPoint, rc.Geometry.Vector3d.ZAxis)
for pt in neighborPoints:
    testVec = rc.Geometry.Vector3d (pt - testPoint)
    anglesList.append(rc.Geometry.Vector3d.VectorAngle(northVec, testVec, basePlane))


# sort the neighbor points based on the angle
neighborsSorted = sortListBasedonList(anglesList, neighborPoints)
# ---------- end findneighbors_2 ----------
tag_2 = TextTag(Location=flatten([pt_5, pt_8, pt_6, pt_9, pt_10, pt_7]), Text=panel)
crv_2 = Curve([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])
boundary_3 = BoundarySurfaces(Edges=item_4)
debrep_2 = DeconstructBrep(Brep=boundary_3)  # -> flatten(Faces), Edges, Vertices
pt_12 = Point(findneighbors_2.pt5)
join = JoinCurves(Curves=debrep_2.Edges, Preserve=False)
value_list = ValueList({"Point": 0, "Curve": 1, "Arc": 2, "Circle": 3, "Ellipse": 4, "Line": 5, "Polyline": 6, "Surface": 7, "Brep": 8, "Mesh": 9, "Polysurface": 10, "Block": 11, "Text": 12, "TextDot": 13, "Dimension": 14, "LinearDimension": 15, "AngularDimension": 16, "Hatch": 17, "Leader": 18}, selected="Polyline")
pln = Plane(PlaneXY(-45, -42, 0))

# ---- group: Space syntax bubble diagram
graphfromnodes_links = GraphFromNodesLinks(Points=[pt_5, pt_8, pt_6, pt_9, pt_10, pt_7], Links=crv_2, Labels=panel, Areas=panel_2)  # -> Graph, GraphVertices, Attributes
forcedirecteddrawing = ForceDirectedDrawing(
    Graph=graphfromnodes_links.Graph,
    Vertices=graphfromnodes_links.GraphVertices,
    Attributes=graphfromnodes_links.Attributes,
    AttractionStrength=Slider(0.003, range=0.001..0.02),
    RepulsionStrength=Slider(0.27, range=0.01..1.4),
    ConvergenceTolearnce=0.001,
    MaximumIterations=4000,
    Active=Toggle(True))  # -> NewGraphVertices, IterationCount
diskographdrawing = DiskoGraphDrawing(
    Plane=pln,
    Graph=graphfromnodes_links.Graph,
    Vertices=forcedirecteddrawing.NewGraphVertices,
    Attributes=graphfromnodes_links.Attributes,
    Thickness=1)

# ---- group: Generating new verices connection
point = Point(forcedirecteddrawing.NewGraphVertices)
list_item = ListItem(List=point, Index=graphfromnodes_links.Graph, Wrap=True)
line = Line(StartPoint=graft(point), EndPoint=list_item)  # -> flatten(Line)

# ----
brec_2 = BoundingRectangle(Geometry=point, Plane=PlaneXY(0, 0, 0), Axis=0, Slide=0, Union=True)  # -> Bounding, DimensionX, DimensionY
move2pt_2 = MoveToPoint(Geometry=flatten(brec.Bounding), PointA=flatten(area_3.Centroid), PointB=flatten(point))  # -> Moved, Vector, Transform
area_4 = Area(Geometry=brec_2.Bounding)  # -> Area, Centroid
move2pt_3 = MoveToPoint(Geometry=simplify([line, move2pt_2.Moved, point]), PointA=flatten(area_4.Centroid), PointB=flatten(pt_2))  # -> Moved, Vector, Transform
lng = ListLength(List=line)
partition_2 = PartitionList(List=move2pt_3.Moved, Size=lng)
bang_2 = ExplodeTree(Data=partition_2)  # -> Branch0, _00000, Branch2
debrep_3 = DeconstructBrep(Brep=flatten(bang_2.Branch2))  # -> flatten(Faces), Edges, flatten(Vertices)
length_line = LengthLine(Line=flatten(bang_2.Branch0), Length=0, Strength="100")
onplane = OnPlane(Points=bang_2._00000, Plane=graft(PlaneXY(0, 0, 0)), Strength=Slider(1000000, range=0..1000000))
cc = CurveCollide(Curves=flatten(debrep_3.Faces), PassiveCurves=flatten(debrep_3.Edges), BasePlane=PlaneXY(0, 0, 0), Strength="100000000")  # -> Goal, Frames
solver = Solver(
    GoalObjects=flatten([cc.Goal, onplane, length_line]),
    Reset=Button(),
    Threshold="0.00001",
    Tolerance=0.0001,
    On=Toggle(True))  # -> I, V, O
filter_by_type = FilterByType(Geometry=solver.O, ObjectType=value_list)
integration = IntegrationAnalysis(Graph=graphfromnodes_links.Graph, Attributes=graphfromnodes_links.Attributes)  # -> DepthTable, DepthMap, RelativeASymetry, Integration, IntegrationRelativeColors, IntegrationTags
surface = Surface(filter_by_type)
pln_2 = Plane(PlaneXY(213, -94, 0))
debrep_4 = DeconstructBrep(Brep=surface)  # -> flatten(Faces), Edges, Vertices
justifiedgraph = JustifiedGraphDrawing(
    ViewPointIndex=Slider(20, range=1..20),
    Plane=pln_2,
    Size="20",
    Thickness="2",
    Graph=graphfromnodes_links.Graph,
    Attributes=graphfromnodes_links.Attributes,
    DepthTable=integration.DepthTable)
area_5 = Area(Geometry=debrep_4.Faces)  # -> Area, Centroid
brep = Brep(debrep_4.Faces)
tag_3 = TextTag(Location=area_5.Centroid, Text=panel)
