# Grasshopper definition mesh relaxation.gh (Grasshopper 1.0.7)
# plug-ins: Weaverbird, Kangaroo2 Components, EleFront

number_slider = Slider(16, range=0..100)
inner_side = Mesh([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])

# ---- group: ribs inside
mesh = Mesh([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])

# ---- group: ribs outside
mesh_2 = Mesh([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])

# ---- group: key stone
mesh_3 = Mesh([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])

# ---- group: ribs outside
mesh_4 = Mesh([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])

# ---- group: support
crv = Curve([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])

# ----
wbsplitquads = WeaverbirdsConstantQuadsSplitSubdivision(MeshCurves=inner_side, Level=Slider(1, range=0..10), SmoothNakedEdges=0)
disc = Discontinuity(Curve=crv, Level=1)  # -> Points, Parameters
cluster = Cluster(data=number_slider, M=mesh)
cluster_2 = Cluster(data=number_slider, M=mesh_2)
wbsplitquads_2 = WeaverbirdsConstantQuadsSplitSubdivision(MeshCurves=wbsplitquads, Level=Slider(3, range=0..10), SmoothNakedEdges=0)
unim = UnifyMesh(Mesh=wbsplitquads_2)  # -> Result, Count
cullpt = CullDuplicates(Points=disc.Points, Tolerance=Slider(0.001, range=0..0.001), CullMode=3)  # -> Points, Indices, Valence
demesh = DeconstructMesh(Mesh=cluster_2)  # -> flatten(Vertices), Faces, Colours, Normals
merge = Merge(Data1=unim.Result, Data2=cluster, Data3=cluster_2, Data4=mesh_3, Data5=mesh_4)  # -> flatten(Result)

number_slider_2 = Slider(100000000, range=0..100000000)
demesh_2 = DeconstructMesh(Mesh=mesh_3)  # -> Vertices, Faces, Colours, Normals
Z = UnitZ(Factor=Slider(0.85, range=0..1))
edgelengths = EdgeLengths(Mesh=merge, LengthFactor=0, Strength=Slider(100, range=0..100))
anchorxyz = AnchorXYZ(Point=demesh.Vertices, X=True, Y=True, Z=False, Strength=number_slider_2)
anchorxyz_2 = AnchorXYZ(Point=demesh_2.Vertices, X=True, Y=True, Z=False, Strength=number_slider_2)
anchor = Anchor(Point=cullpt.Points, Strength=Slider(10000000, range=0..10000000))
vertexloads = VertexLoads(Mesh=merge, Strength=Z)
show = Show(G=merge)

solver = Solver(
    GoalObjects=[anchorxyz, show, anchorxyz_2, edgelengths, anchor, vertexloads],
    Reset=Button(),
    Threshold=1e-15,
    Tolerance=0.01,
    On=Toggle(False))  # -> I, V, flatten(O)
list = ValueList({"Point": 0, "Curve": 1, "Arc": 2, "Circle": 3, "Ellipse": 4, "Line": 5, "Polyline": 6, "Surface": 7, "Brep": 8, "Mesh": 9, "Polysurface": 10, "Block": 11, "Text": 12, "TextDot": 13, "Dimension": 14, "LinearDimension": 15, "AngularDimension": 16, "Hatch": 17, "Leader": 18}, selected="Mesh")
filtertype = FilterByType(Geometry=solver.O, ObjectType=list)
null = NullItem(Item=filtertype)  # -> NullFlags, InvalidFlags, Description
dispatch = Dispatch(List=filtertype, DispatchPattern=null.NullFlags)  # -> ListA, ListB
lng = ListLength(List=mesh_4)
lng_2 = ListLength(List=inner_side)
lng_3 = ListLength(List=mesh)
lng_4 = ListLength(List=mesh_3)
lng_5 = ListLength(List=mesh_2)
data = Data(dispatch.ListB)
addition = Addition(A=lng_3, B=lng_5)
addition_2 = Addition(A=addition, B=lng_4)
addition_3 = Addition(A=lng, B=addition_2)
series = Series(Start=0, Step=1, Count=lng_3)
series_2 = Series(Start=lng_3, Step=1, Count=lng_5)
series_3 = Series(Start=addition, Step=1, Count=lng_4)
series_4 = Series(Start=addition_2, Step=addition_3, Count=lng)
series_5 = Series(Start=addition_3, Step=1, Count=lng_2)
item = ListItem(List=data, Index=series_4, Wrap=True)
item_2 = ListItem(List=data, Index=series_3, Wrap=True)
item_3 = ListItem(List=data, Index=series, Wrap=True)
item_4 = ListItem(List=data, Index=series_2, Wrap=True)

# ---- group: ribs
merge_2 = Merge(Data1=item_3, Data2=item_4, Data3=item_2, Data4=item)

# ---- group: roof filling
item_5 = ListItem(List=data, Index=series_5, Wrap=True)

# ==== cluster Cluster
M = ClusterInput()
demesh = DeconstructMesh(Mesh=M)  # -> Vertices, Faces, Colours, Normals
item = ListItem(List=demesh.Vertices, Index=0, Wrap=True)  # -> Item, Item1, Item2, Item3
data = ClusterInput()
ln = Line(StartPoint=item.Item1, EndPoint=item.Item2)
ln_2 = Line(StartPoint=item.Item, EndPoint=item.Item3)
data_2 = Data(data)
divide = DivideCurve(Curve=ln_2, Count=data_2, Kinks=False)  # -> Points, Tangents, Parameters
divide_2 = DivideCurve(Curve=ln, Count=data_2, Kinks=False)  # -> Points, Tangents, Parameters
panel = Panel("""0
1""")
weave = Weave(Pattern=panel, Stream0=divide.Points, Stream1=divide_2.Points, NullGaps=False)  # -> simplify(Weave)
series = Series(Start=0, Step=2, Count=data_2)
series_2 = Series(Start=1, Step=2, Count=data_2)
series_3 = Series(Start=3, Step=2, Count=data_2)
series_4 = Series(Start=2, Step=2, Count=data_2)
entwine = Entwine(Branch00=series, Branch01=series_2, Branch02=series_3, Branch03=series_4, FlattenInputs=True)
flip = FlipMatrix(Data=entwine)
item_2 = ListItem(List=flip, Index=0, Wrap=True)  # -> Item, Item1, Item2, Item3
format = Format(Format="Q({0},{1},{2},{3})", Culture=127, Data0=item_2.Item, Data1=item_2.Item1, Data2=item_2.Item2, Data3=item_2.Item3)  # -> flatten(Text)
conmesh = ConstructMesh(Vertices=weave, Faces=format)  # -> flatten(Mesh)
mesh = Mesh(graft(conmesh))
unim = UnifyMesh(Mesh=mesh)  # -> Result, Count
mesh_2 = Mesh(flatten(unim.Result))
M_2 = ClusterOutput(conmesh)
panel_2 = Panel(conmesh)
