# Grasshopper definition structural analysis_2floor house.gh (Grasshopper 1.0.7)
# plug-ins: Weaverbird, karambaGH

# ---- group: support
crv = Curve([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])

# ---- group: relaxed roof filling
data = Data([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])

# ---- group: ribs
data_2 = Data([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])

# ----
base = Data([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])
disc = Discontinuity(Curve=crv, Level=1)  # -> Points, Parameters
cullpt = CullDuplicates(Points=disc.Points, Tolerance=Slider(0.001, range=0..0.001), CullMode=3)  # -> Points, Indices, Valence
height_of_columns_for_second_floor = Slider(1, range=0..10)
height_of_columns_for_first_floor = Slider(1.5, range=0..10)
height_of_slab = Slider(2.4, range=0..10)
data_3 = Data(data_2)
wbjoin = WeaverbirdsJoinMeshesAndWeld(Mesh=data_3, Weld=True)
crv_2 = Curve(crv)
wbjoin_2 = WeaverbirdsJoinMeshesAndWeld(Mesh=data, Weld=True)
merge = Merge(Data2=wbjoin, Data3=wbjoin_2)  # -> flatten(Result)
wbjoin_3 = WeaverbirdsJoinMeshesAndWeld(Mesh=merge, Weld=False)
wbjoin_4 = WeaverbirdsJoinMeshesAndWeld(Mesh=flatten(wbjoin_3), Weld=True)
wbjoin_5 = WeaverbirdsJoinMeshesAndWeld(Mesh=flatten(base), Weld=False)

# ---- group: columns
addition = Addition(A=height_of_slab, B=height_of_columns_for_second_floor)
data_4 = Data(height_of_columns_for_second_floor)
Z = UnitZ(Factor=addition)
Z_2 = UnitZ(Factor=data_4)
extr = Extrude(Base=crv_2, Direction=Z_2)
debrep = DeconstructBrep(Brep=extr)  # -> Faces, Edges, Vertices
data_5 = Data(height_of_columns_for_first_floor)
data_6 = Data(height_of_slab)
mesh_uv = MeshSurface(Surface=debrep.Faces, UCount=5, VCount=Slider(1, range=0..10), Overhang=True, Equalize=False)
Z_3 = UnitZ(Factor=data_5)
Z_4 = UnitZ(Factor=data_6)
data_7 = Data(height_of_slab)
extr_2 = Extrude(Base=crv_2, Direction=Z_3)
extr_3 = Extrude(Base=crv_2, Direction=Z_4)
Z_5 = UnitZ(Factor=data_7)
debrep_2 = DeconstructBrep(Brep=extr_2)  # -> Faces, Edges, Vertices
debrep_3 = DeconstructBrep(Brep=extr_3)  # -> Faces, Edges, Vertices
neg = Negative(Value=data_6)
neg_2 = Negative(Value=data_5)
mesh_uv_2 = MeshSurface(Surface=debrep_2.Faces, UCount=5, VCount=Slider(1, range=0..10), Overhang=True, Equalize=False)
Z_6 = UnitZ(Factor=neg_2)
wbjoin_6 = WeaverbirdsJoinMeshesAndWeld(Mesh=flatten(mesh_uv), Weld=True)
mesh_uv_3 = MeshSurface(Surface=debrep_3.Faces, UCount=10, VCount=Slider(1, range=0..10), Overhang=True, Equalize=False)
Z_7 = UnitZ(Factor=neg)
move = Move(Geometry=mesh_uv_2, Motion=Z_6)  # -> Geometry, Transform
move_2 = Move(Geometry=mesh_uv_3, Motion=Z_7)  # -> Geometry, Transform
move_3 = Move(Geometry=wbjoin_6, Motion=Z_5)  # -> Geometry, Transform
wbjoin_7 = WeaverbirdsJoinMeshesAndWeld(Mesh=flatten(move_2.Geometry), Weld=True)
move_4 = Move(Geometry=wbjoin_7, Motion=Z_5)  # -> Geometry, Transform
wbjoin_8 = WeaverbirdsJoinMeshesAndWeld(Mesh=flatten(move.Geometry), Weld=True)
wbjoin_9 = WeaverbirdsJoinMeshesAndWeld(Mesh=flatten(move_3.Geometry), Weld=True)
wbjoin_10 = WeaverbirdsJoinMeshesAndWeld(Mesh=flatten(move_4.Geometry), Weld=True)

# ---- group: first floor load
demesh = DeconstructMesh(Mesh=wbjoin_4)  # -> Vertices, Faces, Colours, Normals
data_8 = Data(flatten(demesh.Faces))
panel = Panel("""1
2
3""")
split = TextSplit(Text=data_8, Separators="{},;,;")
item = ListItem(List=split, Index=panel, Wrap=True)  # -> simplify(Item)
data_9 = Data(data_7)
multiplication = Multiplication(A=Slider(1400, range=0..10000), B=0.00984)
item_2 = ListItem(List=demesh.Vertices, Index=item, Wrap=True)
Z_8 = UnitZ(Factor=data_9)
xy = XYPlane(Origin=Point(0, 0, 0))
pline = PolyLine(Vertices=item_2, Closed=True)
move_5 = Move(Geometry=xy, Motion=Z_8)  # -> Geometry, Transform
srf = Surface(pline)
data_10 = Data(multiplication)
area = Area(Geometry=srf)  # -> Area, Centroid
project = Project(Geometry=area.Centroid, Plane=move_5.Geometry)  # -> Geometry, Transform
ln = Line(StartPoint=project.Geometry, EndPoint=area.Centroid)
len = Length(Curve=ln)
multiplication_2 = Multiplication(A=data_10, B=len)
neg_3 = Negative(Value=multiplication_2)
Z_9 = UnitZ(Factor=neg_3)  # -> flatten(UnitVector)
move_6 = Move(Geometry=wbjoin_5, Motion=Z_8)  # -> Geometry, Transform

# ----
multiplication_3 = Multiplication(A=Slider(1700, range=0..10000), B=0.00984)
division = Division(A="25", B="2.5")
Z_10 = UnitZ(Factor=addition)
matprops = MaterialPropertiesKaramba3D(
    FamilyOfMaterial="Steel",
    Name="S235",
    YoungsModulus_kN_cm2="25",
    InPlaneShearModulus_kN_cm2=division,
    TransverseShearModulus_kN_cm2=division,
    SpecificWeight_kN_m3=multiplication_3,
    CoefficientOfThermalExpansion_1_C=1e-05,
    YieldStrength_kN_cm2="0.3",
    mode="Isotrop")
move_7 = Move(Geometry=wbjoin_4, Motion=Z_10)  # -> Geometry, Transform
item_3 = ListItem(List=move_7.Geometry, Index=0, Wrap=True)  # -> Item, Item1, Item2, Item3, Item4
data_11 = Data([item_3.Item3, item_3.Item4, item_3.Item2, item_3.Item1])
data_12 = Data(data)
data_13 = Data(data_2)
wbjoin_11 = WeaverbirdsJoinMeshesAndWeld(Mesh=data_13, Weld=True)
wbjoin_12 = WeaverbirdsJoinMeshesAndWeld(Mesh=data_12, Weld=True)
data_14 = Data(data)
data_15 = Data(data_2)
move_8 = Move(Geometry=cullpt.Points, Motion=Z_6)  # -> flatten(Geometry), Transform
safety_factor = Slider(1.35, range=0..2.5)

# ---- group: people
Z_11 = UnitZ(Factor=Slider(1, range=0..10))
data_16 = Data(move_6.Geometry)
multiplication_4 = Multiplication(A="2", B=safety_factor)
move_9 = Move(Geometry=data_16, Motion=Z_11)  # -> Geometry, Transform
neg_4 = Negative(Value=multiplication_4)
Z_12 = UnitZ(Factor=neg_4)
loads = LoadsKaramba3D(Vector=Z_12, Mesh=move_9.Geometry, LCase="2", mode="MeshLoad -Const.", menu=[buttons(off, on, off), buttons(on, off)])

# ---- group: roof service
safety_factor_2 = Slider(1.35, range=0..2.5)
data_17 = Data(move_6.Geometry)
Z_13 = UnitZ(Factor=Slider(5, range=0..10))
multiplication_5 = Multiplication(A="1", B=safety_factor_2)
move_10 = Move(Geometry=data_17, Motion=Z_13)  # -> Geometry, Transform
Z_14 = UnitZ(Factor=multiplication_5)
rev = Reverse(Vector=Z_14)
loads_2 = LoadsKaramba3D(Vector=rev, Mesh=move_10.Geometry, LCase="1", mode="MeshLoad -Const.", menu=[buttons(off, on, off), buttons(on, off)])

# ---- group: wind load
safety_factor_3 = Slider(1.35, range=0..2.5)
number_slider = Slider(15, range=0..100)
srf_2 = Surface(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)
multiplication_6 = Multiplication(A=Slider(1.5, range=0..10), B=safety_factor_3)
mesh_uv_4 = MeshSurface(Surface=srf_2, UCount=number_slider, VCount=number_slider, Overhang=True, Equalize=False)
Y = UnitY(Factor=multiplication_6)
neg_5 = Negative(Value=Y)
loads_3 = LoadsKaramba3D(Vector=neg_5, Mesh=mesh_uv_4, LCase="5", mode="MeshLoad -Const.", menu=[buttons(off, on, off), buttons(on, on)])

# ----
data_18 = Data(wbjoin_9)
data_19 = Data(wbjoin_8)
data_20 = Data(wbjoin_10)
move_11 = Move(Geometry=wbjoin_11, Motion=Z)  # -> Geometry, Transform
wbjoin_13 = WeaverbirdsJoinMeshesAndWeld(Mesh=data_15, Weld=True)
wbjoin_14 = WeaverbirdsJoinMeshesAndWeld(Mesh=data_14, Weld=True)
move_12 = Move(Geometry=wbjoin_12, Motion=Z)  # -> Geometry, Transform

# ---- group: Gravity
safety_factor_4 = Slider(1.5, range=0..2.5)
multiplication_7 = Multiplication(A="1", B=safety_factor_4)
Z_15 = UnitZ(Factor=multiplication_7)
rev_2 = Reverse(Vector=Z_15)
loads_4 = LoadsKaramba3D(Vector=rev_2, LCase="0", mode="Gravity")

# ----
merge_2 = Merge(Data1=data_20, Data2=data_18, Data3=data_19)

# ---- group: Cross sections
cullpt_2 = CullDuplicates(Points=move_8.Geometry, Tolerance=0.001, CullMode=3)  # -> Points, Indices, Valence
supp = SupportKaramba3D(PosInd=cullpt_2.Points, menu=[buttons(on, on, on, on, on, on)])
cross_section = CrossSectionKaramba3D(
    FamilyNameOfCrossSection="DefaultCroSec",
    ElementIdentifier="roof(thick)",
    Material=matprops,
    Height_cm=Slider(20, range=1..200),
    mode="Shell - Const")
cross_section_2 = CrossSectionKaramba3D(
    FamilyNameOfCrossSection="DefaultCroSec",
    ElementIdentifier="slab",
    Material=matprops,
    Height_cm=Slider(20, range=1..200),
    mode="Shell - Const")
cross_section_3 = CrossSectionKaramba3D(
    FamilyNameOfCrossSection="DefaultCroSec",
    ElementIdentifier="roof",
    Material=matprops,
    Height_cm=Slider(10, range=1..200),
    mode="Shell - Const")
cross_section_4 = CrossSectionKaramba3D(
    FamilyNameOfCrossSection="DefaultCroSec",
    ElementIdentifier="walls",
    Material=matprops,
    Height_cm=Slider(10, range=1..200),
    mode="Shell - Const")
cross_section_5 = CrossSectionKaramba3D(
    FamilyNameOfCrossSection="DefaultCroSec",
    ElementIdentifier="first floor(thick)",
    Material=matprops,
    Height_cm=Slider(20, range=1..200),
    mode="Shell - Const")
cross_section_6 = CrossSectionKaramba3D(
    FamilyNameOfCrossSection="DefaultCroSec",
    ElementIdentifier="first floor",
    Material=matprops,
    Height_cm=Slider(10, range=1..200),
    mode="Shell - Const")
cross_section_7 = CrossSectionKaramba3D(
    FamilyNameOfCrossSection="DefaultCroSec",
    ElementIdentifier="columns",
    Material=matprops,
    Height_cm=Slider(40, range=1..200),
    mode="Shell - Const")

# ---- group: elements
data_21 = Data(move_11.Geometry)
mesh = Mesh([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])
data_22 = Data(move_6.Geometry)
wbjoin_15 = WeaverbirdsJoinMeshesAndWeld(Mesh=flatten(merge_2), Weld=True)
data_23 = Data(move_12.Geometry)
meshtoshell = MeshToShellKaramba3D(Mesh=flatten(mesh), Identifier="walls", CrossSection=cross_section, LimitDistance_m=0.005)  # -> Element, Points, Info
meshtoshell_2 = MeshToShellKaramba3D(Mesh=flatten(data_22), Identifier="slab", CrossSection=cross_section, LimitDistance_m=0.005)  # -> Element, Points, Info
meshtoshell_3 = MeshToShellKaramba3D(Mesh=flatten(data_21), Identifier="roof(thick)", CrossSection=cross_section, LimitDistance_m=0.005)  # -> Element, Points, Info
meshtoshell_4 = MeshToShellKaramba3D(Mesh=flatten(data_23), Identifier="roof", CrossSection=cross_section_3, LimitDistance_m=0.005)  # -> Element, Points, Info
meshtoshell_5 = MeshToShellKaramba3D(Mesh=flatten(wbjoin_13), Identifier="first floor(thick)", LimitDistance_m=0.005)  # -> Element, Points, Info
meshtoshell_6 = MeshToShellKaramba3D(Mesh=flatten(wbjoin_14), Identifier="first floor", LimitDistance_m=0.005)  # -> Element, Points, Info
meshtoshell_7 = MeshToShellKaramba3D(Mesh=flatten(wbjoin_15), Identifier="columns", LimitDistance_m=0.005)  # -> Element, Points, Info

# ---- group: first floor dead load
loads_5 = LoadsKaramba3D(
    Vectors=Z_9,
    Mesh=move_6.Geometry,
    ElementIdentifiers="first floor",
    LCase="4",
    mode="MeshLoad -Variable",
    menu=[buttons(on, off, off), buttons(on, on)])

# ----
merge_3 = Merge(
    Data1=cross_section,
    Data2=cross_section_2,
    Data3=cross_section_3,
    Data4=cross_section_4,
    Data5=cross_section_5,
    Data6=cross_section_6,
    Data7=cross_section_7)
merge_4 = Merge(
    Data1=meshtoshell.Element,
    Data2=meshtoshell_3.Element,
    Data3=meshtoshell_4.Element,
    Data4=meshtoshell_5.Element,
    Data5=meshtoshell_6.Element,
    Data6=meshtoshell_7.Element,
    Data7=meshtoshell_2.Element)
merge_5 = Merge(Data1=loads_4, Data2=loads_2, Data3=loads, Data4=loads_3, Data5=loads_5)
assemble = AssembleModelKaramba3D(Elem=merge_4, Support=supp, Load=merge_5, CrossSection=merge_3, LimitDistance_m=0.005)  # -> Model, Info, Mass_kg, CenterOfGravity
analyze = AnalyzeKaramba3D(Model=assemble.Model)  # -> CalculatedModel, MaximumDisplacement_cm, ResultingForceOfGravity_kN, ElasticEnergy_kNm

# ---- group: legend palette
swatch = ColourSwatch(SwatchColor=RGB(255, 255, 255))
swatch_2 = ColourSwatch(SwatchColor=RGB(133, 174, 204))
swatch_3 = ColourSwatch(SwatchColor=RGB(55, 41, 84))
swatch_4 = ColourSwatch(SwatchColor=RGB(191, 154, 94))

# ----
swatch_5 = ColourSwatch(SwatchColor=RGB(92, 121, 196))
swatch_6 = ColourSwatch(SwatchColor=RGB(198, 187, 31))
panel_2 = Panel("first floor")
panel_3 = Panel("roof(thick)")
panel_4 = Panel("columns")
panel_6 = Panel("first floor(thick)")
panel_7 = Panel("roof")
merge_6 = Merge(Data1=swatch_3, Data2=swatch, Data3=swatch_4, Data4=swatch_2, Data5=ColourSwatch(SwatchColor=RGB(104, 140, 166)))
modelview = ModelViewKaramba3D(Model=analyze.CalculatedModel, ResultFactors=1, ResultCase=-1, Colors=merge_6)  # -> Model, DeformedMesh, DeformedAxes, DeformedModel
shellview = ShellViewKaramba3D(Model=modelview.Model, IndexOfLayer=0)  # -> Model, MeshesOfRenderedShells, LegendColors, LegendTags
legend = Legend(Colour=shellview.LegendColors, Tags=shellview.LegendTags, LegendType=1)
