# Grasshopper definition structural analysis_hub.gh (Grasshopper 1.0.7)
# plug-ins: karambaGH, Weaverbird

crv = Curve([<curve referenced from the Rhino model> x8])
height_of_columns_for_first_floor = Slider(1.5, range=0..10)
mesh = Mesh([<mesh referenced from the Rhino model> x10])
mesh_2 = Mesh([<mesh referenced from the Rhino model> x7])
disc = Discontinuity(Curve=crv, Level=1)  # -> Points, Parameters
data = Data(height_of_columns_for_first_floor)
Z = UnitZ(Factor=data)
extr = Extrude(Base=crv, Direction=Z)
debrep = DeconstructBrep(Brep=extr)  # -> Faces, Edges, Vertices
neg = Negative(Value=data)
mesh_uv = MeshSurface(Surface=debrep.Faces, UCount=5, VCount=Slider(1, range=0..10), Overhang=True, Equalize=False)
Z_2 = UnitZ(Factor=neg)
move = Move(Geometry=mesh_uv, Motion=Z_2)  # -> Geometry, Transform
wbjoin = WeaverbirdsJoinMeshesAndWeld(Mesh=flatten(move.Geometry), Weld=True)
multiplication = Multiplication(A=Slider(1700, range=0..10000), B=0.00984)
division = Division(A="25", B="2.5")
matprops = MaterialPropertiesKaramba3D(
    FamilyOfMaterial="Steel",
    Name="S235",
    YoungsModulus_kN_cm2="25",
    InPlaneShearModulus_kN_cm2=division,
    TransverseShearModulus_kN_cm2=division,
    SpecificWeight_kN_m3=multiplication,
    CoefficientOfThermalExpansion_1_C=1e-05,
    YieldStrength_kN_cm2="0.3",
    mode="Isotrop")
move_2 = Move(Geometry=flatten(disc.Points), Motion=Z_2)  # -> Geometry, Transform
data_2 = Data(wbjoin)
data_3 = Data(mesh_2)
data_4 = Data(mesh)
wbjoin_2 = WeaverbirdsJoinMeshesAndWeld(Mesh=[data_3, data_4], Weld=True)
cullpt = CullDuplicates(Points=move_2.Geometry, Tolerance=Slider(0.001, range=0..0.001), CullMode=3)  # -> Points, Indices, Valence

# ---- group: Gravity
safety_factor = Slider(1.5, range=0..2.5)
multiplication_2 = Multiplication(A="1", B=safety_factor)
Z_3 = UnitZ(Factor=multiplication_2)
rev = Reverse(Vector=Z_3)
loads = LoadsKaramba3D(Vector=rev, LCase="0", mode="Gravity")

# ---- group: roof service
safety_factor_2 = Slider(1.35, range=0..2.5)
data_5 = Data(wbjoin_2)
Z_4 = UnitZ(Factor=Slider(5, range=0..10))
multiplication_3 = Multiplication(A="1", B=safety_factor_2)
move_3 = Move(Geometry=data_5, Motion=Z_4)  # -> Geometry, Transform
Z_5 = UnitZ(Factor=multiplication_3)
rev_2 = Reverse(Vector=Z_5)
loads_2 = LoadsKaramba3D(Vector=rev_2, Mesh=move_3.Geometry, LCase="1", mode="MeshLoad -Const.", menu=[buttons(off, on, off), buttons(on, off)])

# ----
number_slider = Slider(1, range=0..10)
wbjoin_3 = WeaverbirdsJoinMeshesAndWeld(Mesh=data_3, Weld=True)
wbjoin_4 = WeaverbirdsJoinMeshesAndWeld(Mesh=data_4, Weld=True)
wbjoin_5 = WeaverbirdsJoinMeshesAndWeld(Mesh=flatten(data_2), Weld=True)
srf = Surface(<surface referenced from the Rhino model>)
supp = SupportKaramba3D(PosInd=cullpt.Points, menu=[buttons(on, on, on, on, on, on)])
mesh_uv_2 = MeshSurface(Surface=srf, UCount=5, VCount=5, Overhang=True, Equalize=False)

# ---- group: wind load
safety_factor_3 = Slider(1.35, range=0..2.5)
multiplication_4 = Multiplication(A=number_slider, B=safety_factor_3)
Y = UnitY(Factor=number_slider)
loads_3 = LoadsKaramba3D(Vector=Y, Mesh=mesh_uv_2, LCase=0, mode="MeshLoad -Const.", menu=[buttons(off, on, off), buttons(on, on)])

# ----
cross_section = CrossSectionKaramba3D(
    FamilyNameOfCrossSection="DefaultCroSec",
    ElementIdentifier="roof(thick)",
    Material=matprops,
    Height_cm=Slider(20, range=1..200),
    mode="Shell - Const")
cross_section_2 = CrossSectionKaramba3D(
    FamilyNameOfCrossSection="DefaultCroSec",
    ElementIdentifier="roof",
    Material=matprops,
    Height_cm=Slider(10, range=1..200),
    mode="Shell - Const")
cross_section_3 = CrossSectionKaramba3D(
    FamilyNameOfCrossSection="DefaultCroSec",
    ElementIdentifier="first floor",
    Material=matprops,
    Height_cm=Slider(20, range=1..200),
    mode="Shell - Const")
cross_section_4 = CrossSectionKaramba3D(
    FamilyNameOfCrossSection="DefaultCroSec",
    ElementIdentifier="first floor(thick)",
    Material=matprops,
    Height_cm=Slider(20, range=1..200),
    mode="Shell - Const")
cross_section_5 = CrossSectionKaramba3D(
    FamilyNameOfCrossSection="DefaultCroSec",
    ElementIdentifier="slab",
    Material=matprops,
    Height_cm=Slider(10, range=1..200),
    mode="Shell - Const")
cross_section_6 = CrossSectionKaramba3D(
    FamilyNameOfCrossSection="DefaultCroSec",
    ElementIdentifier="columns",
    Material=matprops,
    Height_cm=Slider(50, range=1..200),
    mode="Shell - Const")
meshtoshell = MeshToShellKaramba3D(Mesh=flatten(wbjoin_3), Identifier="first floor(thick)", LimitDistance_m=0.005)  # -> Element, Points, Info
meshtoshell_2 = MeshToShellKaramba3D(Mesh=flatten(wbjoin_4), Identifier="first floor", LimitDistance_m=0.005)  # -> Element, Points, Info
meshtoshell_3 = MeshToShellKaramba3D(Mesh=flatten(wbjoin_5), Identifier="columns", LimitDistance_m=0.005)  # -> Element, Points, Info
merge = Merge(Data4=meshtoshell.Element, Data5=meshtoshell_2.Element, Data6=meshtoshell_3.Element)
merge_2 = Merge(
    Data1=cross_section,
    Data2=cross_section_5,
    Data3=cross_section_2,
    Data4=cross_section_4,
    Data5=cross_section_3,
    Data6=cross_section_6)
merge_3 = Merge(Data1=loads, Data2=loads_2, Data3=loads_3)
assemble = AssembleModelKaramba3D(Elem=merge, Support=supp, Load=merge_3, CrossSection=merge_2, LimitDistance_m=0.005)  # -> Model, Info, Mass_kg, CenterOfGravity
analyze = AnalyzeKaramba3D(Model=assemble.Model)  # -> CalculatedModel, MaximumDisplacement_cm, ResultingForceOfGravity_kN, ElasticEnergy_kNm
react = ReactionForcesKaramba3D(AnalyzedModel=analyze.CalculatedModel, ResultCase=0)  # -> AnalyzedModel, ReactionForces_kN, ReactionMoments_kNm, SupportPosition, SumOfReactionForces_kN, SumOfReactionMoments_kNm

# ---- group: legend palette
swatch = ColourSwatch(SwatchColor=RGB(255, 255, 255))
swatch_2 = ColourSwatch(SwatchColor=RGB(133, 174, 204))
swatch_3 = ColourSwatch(SwatchColor=RGB(55, 41, 84))
swatch_4 = ColourSwatch(SwatchColor=RGB(191, 154, 94))

# ----
sort = SortList(Keys=react.ReactionForces_kN)  # -> Keys, ValuesA
panel = Panel("first floor")
panel_2 = Panel("columns")
panel_3 = Panel("first floor(thick)")
merge_4 = Merge(Data1=swatch_3, Data2=swatch, Data3=swatch_4, Data4=swatch_2, Data5=ColourSwatch(SwatchColor=RGB(104, 140, 166)))
panel_4 = Panel(sort.Keys)
modelview = ModelViewKaramba3D(Model=analyze.CalculatedModel, ResultFactors=1, ResultCase=-1, Colors=merge_4)  # -> Model, DeformedMesh, DeformedAxes, DeformedModel
modelview_2 = ModelViewKaramba3D(Model=modelview.Model, LoadCaseFactorsForLinearSuperposition=1, IndexOfVisibleLoadcase=-1)  # -> Model, DeformedMesh, DeformedAxes, DeformedModel
shellview = ShellViewKaramba3D(Model=modelview.Model, IndexOfLayer=0)  # -> Model, MeshesOfRenderedShells, LegendColors, LegendTags
cull_i = CullIndex(List=shellview.LegendTags, Indices=0, Wrap=True)
legend = Legend(Colour=shellview.LegendColors, Tags=shellview.LegendTags, LegendType=1)
