# Grasshopper definition Brick Columns.gh (Grasshopper 1.0.7)

# ----
# Rhino file: Brick columns
# Columns
number_slider = Slider(200, range=0..1000)
number_slider_2 = Slider(200, range=0..1000)
bounding_box_column = Rectangle(Plane=PlaneXY(0, 0, 0), XSize=number_slider, YSize=number_slider_2, Radius=0)  # -> Rectangle, Length
column_rectangle = BoxRectangle(Rectangle=bounding_box_column.Rectangle, Height=Slider(3200, range=0..10000))

number_slider_3 = Slider(200, range=0..1000)
number_slider_4 = Slider(1100, range=0..1500)
# Walls A
bounding_box_column_2 = Rectangle(Plane=PlaneXY(0, 0, 0), XSize=number_slider_3, YSize=number_slider_4, Radius=0)  # -> Rectangle, Length
column_rectangle_2 = BoxRectangle(Rectangle=bounding_box_column_2.Rectangle, Height=Slider(3200, range=0..10000))

number_slider_5 = Slider(200, range=0..1000)
number_slider_6 = Slider(1100, range=0..1500)
# Walls B
bounding_box_column_3 = Rectangle(Plane=PlaneXY(0, 0, 0), XSize=number_slider_5, YSize=number_slider_6, Radius=0)  # -> Rectangle, Length
column_rectangle_3 = BoxRectangle(Rectangle=bounding_box_column_3.Rectangle, Height=Slider(825, range=0..10000))

# ---- group: BRICK
number_slider_7 = Slider(200, range=0..1000)
number_slider_8 = Slider(100, range=0..1000)
number_slider_9 = Slider(75, range=0..1000)

number_slider_10 = Slider(200, range=0..1000)
number_slider_11 = Slider(100, range=0..1000)
number_slider_12 = Slider(75, range=0..1000)

# ---- group: Contour
v_gap = Slider(1.9967, range=1..2)
addition = Addition(Gap=v_gap, Brick=number_slider_9)
xy = XYPlane(Origin=Point(0, 0, 0))
contour = Contour(Shape=column_rectangle_2, Point=xy, Direction=Vector(0, 0, 1), Distance=addition)

v_gap_2 = Slider(1.9967, range=1..2)
addition_2 = Addition(Gap=v_gap_2, Brick=number_slider_12)
xy_2 = XYPlane(Origin=Point(0, 0, 0))
contour_2 = Contour(Shape=column_rectangle_3, Point=xy_2, Direction=Vector(0, 0, 1), Distance=addition_2)

# ----
surface = Surface(contour)
surface_2 = Surface(contour_2)

# ---- group: Selecting alternate surfaces
list_item = ListItem(List=surface, Index=0, Wrap=True)
M = Masks(flatten("{0;(0,2,4...)}"))
split_tree = SplitTree(Data=list_item, Masks=flatten(M))  # -> Positive, Negative

# ---- group: Rotating the alternate surfaces
area = Area(Geometry=surface)  # -> Area, Centroid
radians = Radians(Degrees=Slider(90, range=0..100))
rotate_3d = Rotate3D(Geometry=split_tree.Negative, Angle=radians, Center=area.Centroid, Axis=Vector(0, 0, 1))  # -> Geometry, Transform

# ---- group: Selecting alternate surfaces
list_item_2 = ListItem(List=surface_2, Index=0, Wrap=True)
M_2 = Masks(flatten("{0;(0,2,4...)}"))
split_tree_2 = SplitTree(Data=list_item_2, Masks=flatten(M_2))  # -> Positive, Negative

# ---- group: Rotating the alternate surfaces
area_2 = Area(Geometry=surface_2)  # -> Area, Centroid
radians_2 = Radians(Degrees=Slider(90, range=0..100))
rotate_3d_2 = Rotate3D(Geometry=split_tree_2.Negative, Angle=radians_2, Center=area_2.Centroid, Axis=Vector(0, 0, 1))  # -> Geometry, Transform

# ---- group: Beick 1st layer
breadth_division = Division(A=number_slider_3, B=number_slider_7)
length_division = Division(A=number_slider_4, B=number_slider_8)
surface_3 = Surface(split_tree.Negative)
divide_domain² = DivideDomain²(Domain=surface_3, UCount=breadth_division, VCount=length_division)
isotrim = Isotrim(Surface=surface_3, Domain=divide_domain²)
unit_z = UnitZ(Factor=1)
move = Move(Geometry=isotrim, Motion=unit_z)  # -> Geometry, Transform

# ---- group: Bricks 2nd layer
flip = Flip(Surface=split_tree.Positive)  # -> Surface, Result
length_division_2 = Division(A=number_slider_4, B=number_slider_7)
breadth_division_2 = Division(A=number_slider_3, B=number_slider_8)
surface_4 = Surface(flip.Surface)
divide_domain²_2 = DivideDomain²(Domain=surface_4, UCount=breadth_division_2, VCount=length_division_2)
isotrim_2 = Isotrim(Surface=surface_4, Domain=divide_domain²_2)

# ---- group: Beick 1st layer
breadth_division_3 = Division(A=number_slider_5, B=number_slider_10)
length_division_3 = Division(A=number_slider_6, B=number_slider_11)
surface_5 = Surface(split_tree_2.Negative)
divide_domain²_3 = DivideDomain²(Domain=surface_5, UCount=breadth_division_3, VCount=length_division_3)
isotrim_3 = Isotrim(Surface=surface_5, Domain=divide_domain²_3)
unit_z_2 = UnitZ(Factor=1)
move_2 = Move(Geometry=isotrim_3, Motion=unit_z_2)  # -> Geometry, Transform

# ---- group: Bricks 2nd layer
flip_2 = Flip(Surface=split_tree_2.Positive)  # -> Surface, Result
length_division_4 = Division(A=number_slider_6, B=number_slider_10)
breadth_division_4 = Division(A=number_slider_5, B=number_slider_11)
surface_6 = Surface(flip_2.Surface)
divide_domain²_4 = DivideDomain²(Domain=surface_6, UCount=breadth_division_4, VCount=length_division_4)
isotrim_4 = Isotrim(Surface=surface_6, Domain=divide_domain²_4)

# ---- group: Bricks
unit_z_3 = UnitZ(Factor=Slider(75, range=0..100))
extrude = Extrude(Base=isotrim_2, Direction=unit_z_3)
# brick
cap_holes = CapHoles(Brep=extrude)

unit_z_4 = UnitZ(Factor=Slider(75, range=0..100))
extrude_2 = Extrude(Base=isotrim_4, Direction=unit_z_4)
cap_holes_2 = CapHoles(Brep=extrude_2)

# ----
unit_z_5 = UnitZ(Factor=Slider(75, range=0..100))

# ---- group: Bricks
unit_z_6 = UnitZ(Factor=Slider(75, range=0..100))
extrude_3 = Extrude(Base=move.Geometry, Direction=unit_z_6)
cap_holes_3 = CapHoles(Brep=extrude_3)

# ----
unit_z_7 = UnitZ(Factor=Slider(75, range=0..100))

# ---- group: Bricks
unit_z_8 = UnitZ(Factor=Slider(75, range=0..100))
extrude_4 = Extrude(Base=move_2.Geometry, Direction=unit_z_8)
cap_holes_4 = CapHoles(Brep=extrude_4)

# ----
extrude_5 = Extrude(Base=isotrim_2, Direction=unit_z_5)
extrude_6 = Extrude(Base=isotrim_4, Direction=unit_z_7)
cap_holes_5 = CapHoles(Brep=extrude_5)
cap_holes_6 = CapHoles(Brep=extrude_6)

# ---- group: BRICK
number_slider_13 = Slider(200, range=0..1000)
number_slider_14 = Slider(100, range=0..1000)
number_slider_15 = Slider(75, range=0..1000)
division = Division(A=number_slider_14, B=2)
division_2 = Division(A=number_slider_15, B=2)
division_3 = Division(A=number_slider_13, B=2)

# ---- group: Contour
v_gap_3 = Slider(1.9967, range=1..2)
addition_3 = Addition(Gap=v_gap_3, Brick=number_slider_15)
xy_3 = XYPlane(Origin=Point(0, 0, 0))
contour_3 = Contour(Shape=column_rectangle, Point=xy_3, Direction=Vector(0, 0, 1), Distance=addition_3)

# ----
surface_7 = Surface(contour_3)

# ---- group: Selecting alternate surfaces
list_item_3 = ListItem(List=surface_7, Index=0, Wrap=True)
M_3 = Masks(flatten("{0;(0,2,4...)}"))
split_tree_3 = SplitTree(Data=list_item_3, Masks=flatten(M_3))  # -> Positive, Negative

# ---- group: Rotating the alternate surfaces
area_3 = Area(Geometry=surface_7)  # -> Area, Centroid
radians_3 = Radians(Degrees=Slider(90, range=0..100))
rotate_3d_3 = Rotate3D(Geometry=split_tree_3.Negative, Angle=radians_3, Center=area_3.Centroid, Axis=Vector(0, 0, 1))  # -> Geometry, Transform

# ----
length_division_5 = Division(A=number_slider_2, B=number_slider_13)
breadth_division_5 = Division(A=number_slider_2, B=number_slider_14)

# ---- group: Dividing for bricks
flip_3 = Flip(Surface=split_tree_3.Positive)  # -> Surface, Result
surface_8 = Surface(flip_3.Surface)
divide_domain²_5 = DivideDomain²(Domain=surface_8, UCount=breadth_division_5, VCount=length_division_5)
number_slider_16 = Slider(75, range=0..100)

surface_9 = Surface(rotate_3d_3.Geometry)
divide_domain²_6 = DivideDomain²(Domain=surface_9, UCount=breadth_division_5, VCount=length_division_5)
isotrim_5 = Isotrim(Surface=surface_9, Domain=divide_domain²_6)

# ----
isotrim_6 = Isotrim(Surface=surface_8, Domain=divide_domain²_5)
unit_z_9 = UnitZ(Factor=number_slider_16)
unit_z_10 = UnitZ(Factor=division_2)
extrude_7 = Extrude(Base=isotrim_6, Direction=unit_z_9)
move_3 = Move(Geometry=isotrim_5, Motion=unit_z_10)  # -> Geometry, Transform
cap_holes_7 = CapHoles(Brep=extrude_7)
area_4 = Area(Geometry=move_3.Geometry)  # -> Area, Centroid

# ---- group: BRICK (continued)
brick_box = CenterBox(Base=area_4.Centroid, X=division_3, Y=division, Z=division_2)
