# Grasshopper definition roof bricks.gh (Grasshopper 1.0.7)

# ---- group: ribs
mesh = Mesh([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])
mesh_2 = Mesh([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])

# ----
panel = Panel("""6
7
8
9""")
cull_i = CullIndex(List=mesh, Indices=panel, Wrap=True)
demesh = DeconstructMesh(Mesh=cull_i)  # -> Vertices, Faces, Colours, Normals
partition = PartitionList(List=demesh.Vertices, Size=2)
pline = PolyLine(Vertices=partition, Closed=False)
midpt = CurveMiddle(Curve=pline)
pshift = ShiftPaths(Data=midpt, Offset=-1)
intcrv = Interpolate(Vertices=pshift, Degree=3, Periodic=False, KnotStyle=1)  # -> Curve, Length, Domain
divide = DivideCurve(Curve=intcrv.Curve, Count=Slider(10, range=0..10), Kinks=False)  # -> Points, Tangents, Parameters
pline_2 = PolyLine(Vertices=divide.Points, Closed=False)
explode = Explode(Curve=pline_2, Recursive=True)  # -> Segments, Vertices
partition_2 = PartitionList(List=explode.Segments, Size=2)
join = JoinCurves(Curves=partition_2, Preserve=False)
end = EndPoints(Curve=join)  # -> Start, End
midpt_2 = CurveMiddle(Curve=join)
arc = Arc3Pt(PointA=end.Start, PointB=midpt_2, PointC=end.End)  # -> Arc, Plane, Radius
neg = Negative(Value=Slider(2, range=0..10))
item = ListItem(List=arc.Arc, Index=Slider(1, range=0..1), Wrap=True)
pshift_2 = ShiftPaths(Data=item, Offset=neg)
panel_2 = Panel("""0
1
-2
-1""")
item_2 = ListItem(List=pshift_2, Index=Slider(2, range=0..10), Wrap=True)
item_3 = ListItem(List=pshift_2, Index=panel_2, Wrap=True)
number_slider = Slider(0.161, range=0..1)
number_slider_2 = Slider(0.1, range=-0.11..0.4)
number_slider_3 = Slider(0.1, range=0..0.2)
len = Length(Curve=item_3)
len_2 = Length(Curve=item_2)
division = Division(A=len, B=number_slider_2)
division_2 = Division(A=len_2, B=number_slider_2)
round = Round(Number=division_2)  # -> Nearest, Floor, Ceiling
hframes = HorizontalFrames(Curve=item_2, Count=round.Floor)  # -> simplify(Frames), Parameters
divide_2 = DivideCurve(Curve=item_2, Count=round.Floor, Kinks=False)  # -> Points, Tangents, Parameters
round_2 = Round(Number=division)  # -> Nearest, Floor, Ceiling
divide_3 = DivideCurve(Curve=item_3, Count=round_2.Floor, Kinks=False)  # -> Points, Tangents, Parameters
hframes_2 = HorizontalFrames(Curve=item_3, Count=round_2.Floor)  # -> simplify(Frames), Parameters
deplane = DeconstructPlane(Plane=hframes.Frames)  # -> Origin, XAxis, simplify(YAxis), ZAxis
deplane_2 = DeconstructPlane(Plane=hframes_2.Frames)  # -> Origin, XAxis, simplify(YAxis), ZAxis
number_slider_4 = Slider(0.1, range=0..1)
pl = ConstructPlane(Origin=hframes_2.Frames, XAxis=deplane_2.YAxis, YAxis=divide_3.Tangents)
deplane_3 = DeconstructPlane(Plane=pl)  # -> Origin, XAxis, simplify(YAxis), ZAxis
pl_2 = ConstructPlane(Origin=hframes.Frames, XAxis=deplane.YAxis, YAxis=divide_2.Tangents)
deplane_4 = DeconstructPlane(Plane=pl_2)  # -> Origin, XAxis, simplify(YAxis), ZAxis
dispatch = Dispatch(List=pl, DispatchPattern=[True, False])  # -> ListA, ListB
rev = Reverse(Vector=deplane_3.ZAxis)
box = CenterBox(Base=pl_2, X=expr("X/2", number_slider_3), Y=expr("X/2", number_slider_2), Z=expr("X/2", number_slider))
debrep = DeconstructBrep(Brep=box)  # -> Faces, Edges, Vertices
line = LineSDL(Start=deplane_4.Origin, Direction=deplane_4.ZAxis, Length=expr("x/2", number_slider_4))
item_4 = ListItem(List=debrep.Faces, Index=4, Wrap=True)
item_5 = ListItem(List=debrep.Faces, Index=5, Wrap=True)
box_2 = CenterBox(Base=pl, X=expr("X/2", number_slider_3), Y=expr("X/2", number_slider_2), Z=expr("X/2", number_slider))
line_2 = LineSDL(Start=pl, Direction=rev, Length=expr("X/2", number_slider_4))
debrep_2 = DeconstructBrep(Brep=item_5)  # -> Faces, Edges, Vertices
debrep_3 = DeconstructBrep(Brep=item_4)  # -> Faces, Edges, Vertices
rev_2 = Reverse(Vector=line)  # -> simplify(Vector)
number_slider_5 = Slider(0.93, range=0..10)
number_slider_6 = Slider(1.46, range=0..10)
data = Data(debrep_2.Edges)
data_2 = Data(number_slider_5)
data_3 = Data(number_slider_6)
item_6 = ListItem(List=data, Index=1, Wrap=True)
midpt_3 = CurveMiddle(Curve=item_6)
item_7 = ListItem(List=data, Index=3, Wrap=True)
midpt_4 = CurveMiddle(Curve=item_7)
scale = Scale(Geometry=item_6, Center=midpt_3, Factor=number_slider_5)  # -> Geometry, Transform
scale_2 = Scale(Geometry=item_7, Center=midpt_4, Factor=data_2)  # -> Geometry, Transform
cp = ControlPoints(Curve=scale_2.Geometry)  # -> Points, Weights, Knots
cp_2 = ControlPoints(Curve=scale.Geometry)  # -> Points, Weights, Knots
item_8 = ListItem(List=cp.Points, Index=0, Wrap=True)  # -> Item, Item1
item_9 = ListItem(List=cp_2.Points, Index=0, Wrap=True)  # -> Item, Item1
cluster = Cluster(data_2=debrep_3.Edges, data=number_slider_6)
srf4pt = _4PointSurface(CornerA=item_9.Item1, CornerB=item_9.Item, CornerC=item_8.Item1, CornerD=item_8.Item)
data_4 = Data(cluster)
data_5 = Data(srf4pt)
debrep_4 = DeconstructBrep(Brep=data_4)  # -> Faces, Edges, Vertices
debrep_5 = DeconstructBrep(Brep=data_5)  # -> Faces, Edges, Vertices
rulesrf = RuledSurface(CurveA=debrep_4.Edges, CurveB=debrep_5.Edges)
join_2 = BrepJoin(Breps=rulesrf)  # -> Breps, Closed
neg_2 = Negative(Value=Slider(5, range=0..10))
cap = CapHoles(Brep=join_2.Breps)
pshift_3 = ShiftPaths(Data=cap, Offset=neg_2)  # -> simplify(Data)
move = Move(Geometry=pshift_3, Motion=rev_2)  # -> Geometry, Transform
panel_3 = Panel("""0
-1""")
cull_i_2 = CullIndex(List=move.Geometry, Indices=panel_3, Wrap=True)
move_2 = Move(Geometry=box_2, Motion=line_2)  # -> Geometry, Transform

panel_4 = Panel("""6
7
8
9""")
item_10 = ListItem(List=mesh, Index=panel_4, Wrap=True)
demesh_2 = DeconstructMesh(Mesh=item_10)  # -> Vertices, Faces, Colours, Normals
partition_3 = PartitionList(List=demesh_2.Vertices, Size=2)
pline_3 = PolyLine(Vertices=partition_3, Closed=False)
midpt_5 = CurveMiddle(Curve=pline_3)
pshift_4 = ShiftPaths(Data=midpt_5, Offset=-1)
intcrv_2 = Interpolate(Vertices=pshift_4, Degree=3, Periodic=False, KnotStyle=1)  # -> Curve, Length, Domain
divide_4 = DivideCurve(Curve=intcrv_2.Curve, Count=Slider(6, range=0..10), Kinks=False)  # -> Points, Tangents, Parameters
pline_4 = PolyLine(Vertices=divide_4.Points, Closed=False)
explode_2 = Explode(Curve=pline_4, Recursive=True)  # -> Segments, Vertices
partition_4 = PartitionList(List=explode_2.Segments, Size=2)
join_3 = JoinCurves(Curves=partition_4, Preserve=False)
midpt_6 = CurveMiddle(Curve=join_3)
end_2 = EndPoints(Curve=join_3)  # -> Start, End
arc_2 = Arc3Pt(PointA=end_2.Start, PointB=midpt_6, PointC=end_2.End)  # -> Arc, Plane, Radius
item_11 = ListItem(List=arc_2.Arc, Index=Slider(1, range=0..1), Wrap=True)
neg_3 = Negative(Value=Slider(2, range=0..10))
pshift_5 = ShiftPaths(Data=item_11, Offset=neg_3)
midpt_7 = CurveMiddle(Curve=pshift_5)
project = Project(Geometry=midpt_7, Plane=PlaneXY(0, 0, 0))  # -> Geometry, Transform
dist = Distance(PointA=midpt_7, PointB=project.Geometry)
panel_5 = Panel("""0
1""")
sort = SortList(Keys=dist, ValuesA=pshift_5)  # -> Keys, ValuesA
item_12 = ListItem(List=sort.ValuesA, Index=2, Wrap=True)
number_slider_7 = Slider(0.161, range=0..1)
number_slider_8 = Slider(0.1, range=-0.11..0.4)
item_13 = ListItem(List=sort.ValuesA, Index=panel_5, Wrap=True)
len_3 = Length(Curve=item_13)
number_slider_9 = Slider(0.1, range=0..0.2)
division_3 = Division(A=len_3, B=number_slider_8)
len_4 = Length(Curve=item_12)
round_3 = Round(Number=division_3)  # -> Nearest, Floor, Ceiling
division_4 = Division(A=len_4, B=number_slider_8)
round_4 = Round(Number=division_4)  # -> Nearest, Floor, Ceiling
hframes_3 = HorizontalFrames(Curve=item_12, Count=round_4.Floor)  # -> simplify(Frames), Parameters
divide_5 = DivideCurve(Curve=item_12, Count=round_4.Floor, Kinks=False)  # -> Points, Tangents, Parameters
divide_6 = DivideCurve(Curve=item_13, Count=round_3.Floor, Kinks=False)  # -> Points, Tangents, Parameters
hframes_4 = HorizontalFrames(Curve=item_13, Count=round_3.Floor)  # -> simplify(Frames), Parameters
deplane_5 = DeconstructPlane(Plane=hframes_4.Frames)  # -> Origin, XAxis, simplify(YAxis), ZAxis
deplane_6 = DeconstructPlane(Plane=hframes_3.Frames)  # -> Origin, XAxis, simplify(YAxis), ZAxis
pl_3 = ConstructPlane(Origin=hframes_4.Frames, XAxis=deplane_5.YAxis, YAxis=divide_6.Tangents)
deplane_7 = DeconstructPlane(Plane=pl_3)  # -> Origin, XAxis, simplify(YAxis), ZAxis
pl_4 = ConstructPlane(Origin=hframes_3.Frames, XAxis=deplane_6.YAxis, YAxis=divide_5.Tangents)
deplane_8 = DeconstructPlane(Plane=pl_4)  # -> Origin, XAxis, simplify(YAxis), ZAxis
number_slider_10 = Slider(1, range=0..10)
number_slider_11 = Slider(1.16, range=0..10)
dispatch_2 = Dispatch(List=pl_3, DispatchPattern=[True, False])  # -> ListA, ListB
rev_3 = Reverse(Vector=deplane_7.ZAxis)
box_3 = CenterBox(Base=pl_4, X=expr("X/2", number_slider_9), Y=expr("X/2", number_slider_8), Z=expr("X/2", number_slider_7))
number_slider_12 = Slider(0.1, range=0..1)
line_3 = LineSDL(Start=deplane_8.Origin, Direction=deplane_8.ZAxis, Length=expr("x/2", number_slider_12))
debrep_6 = DeconstructBrep(Brep=box_3)  # -> Faces, Edges, Vertices
item_14 = ListItem(List=debrep_6.Faces, Index=4, Wrap=True)
item_15 = ListItem(List=debrep_6.Faces, Index=5, Wrap=True)
data_6 = Data(number_slider_10)
box_4 = CenterBox(Base=pl_3, X=expr("X/2", number_slider_9), Y=expr("X/2", number_slider_8), Z=expr("X/2", number_slider_7))
line_4 = LineSDL(Start=pl_3, Direction=rev_3, Length=expr("X/2", number_slider_12))
data_7 = Data(number_slider_11)
panel_6 = Panel("""-1
0""")
debrep_7 = DeconstructBrep(Brep=item_14)  # -> Faces, Edges, Vertices
rev_4 = Reverse(Vector=line_3)  # -> simplify(Vector)
area = Area(Geometry=item_14)  # -> Area, Centroid
debrep_8 = DeconstructBrep(Brep=item_15)  # -> Faces, Edges, Vertices
data_8 = Data(debrep_8.Edges)
item_16 = ListItem(List=data_8, Index=1, Wrap=True)
midpt_8 = CurveMiddle(Curve=item_16)
item_17 = ListItem(List=data_8, Index=3, Wrap=True)
midpt_9 = CurveMiddle(Curve=item_17)
move_3 = Move(Geometry=box_4, Motion=line_4)  # -> Geometry, Transform
scale_nu = ScaleNU(Geometry=item_14, Plane=area.Centroid, ScaleX=1, ScaleY=1, ScaleZ=1)  # -> Geometry, Transform
scale_3 = Scale(Geometry=item_16, Center=midpt_8, Factor=number_slider_10)  # -> Geometry, Transform
scale_4 = Scale(Geometry=item_17, Center=midpt_9, Factor=data_6)  # -> Geometry, Transform
cp_3 = ControlPoints(Curve=scale_4.Geometry)  # -> Points, Weights, Knots
cp_4 = ControlPoints(Curve=scale_3.Geometry)  # -> Points, Weights, Knots
item_18 = ListItem(List=cp_3.Points, Index=0, Wrap=True)  # -> Item, Item1
item_19 = ListItem(List=cp_4.Points, Index=0, Wrap=True)  # -> Item, Item1
srf4pt_2 = _4PointSurface(CornerA=item_19.Item1, CornerB=item_19.Item, CornerC=item_18.Item1, CornerD=item_18.Item)
cluster_2 = Cluster(data_2=debrep_7.Edges, data=number_slider_11)
data_9 = Data(srf4pt_2)
data_10 = Data(cluster_2)
debrep_9 = DeconstructBrep(Brep=data_10)  # -> Faces, Edges, Vertices
debrep_10 = DeconstructBrep(Brep=data_9)  # -> Faces, Edges, Vertices
rulesrf_2 = RuledSurface(CurveA=debrep_9.Edges, CurveB=debrep_10.Edges)
panel_7 = Panel("""0
-1""")
pshift_6 = ShiftPaths(Data=item_15, Offset="-2")  # -> simplify(Data)
join_4 = BrepJoin(Breps=rulesrf_2)  # -> Breps, Closed
neg_4 = Negative(Value=Slider(5, range=0..10))
cap_2 = CapHoles(Brep=join_4.Breps)
panel_8 = Panel("-3")
pshift_7 = ShiftPaths(Data=cap_2, Offset=neg_4)  # -> simplify(Data)
move_4 = Move(Geometry=pshift_7, Motion=rev_4)  # -> Geometry, Transform
cull_i_3 = CullIndex(List=move_4.Geometry, Indices=panel_7, Wrap=True)
merge = Merge(Data1=move_3.Geometry, Data2=cull_i_3)

demesh_3 = DeconstructMesh(Mesh=mesh_2)  # -> Vertices, Faces, Colours, Normals
partition_5 = PartitionList(List=demesh_3.Vertices, Size=2)
pline_5 = PolyLine(Vertices=partition_5, Closed=False)
midpt_10 = CurveMiddle(Curve=pline_5)
pshift_8 = ShiftPaths(Data=midpt_10, Offset=-1)
z = Slider(0.1, range=0..1)
x = Slider(0.1, range=0..0.2)
y = Slider(0.1, range=-0.11..0.4)
intcrv_3 = Interpolate(Vertices=pshift_8, Degree=3, Periodic=False, KnotStyle=1)  # -> Curve, Length, Domain
len_5 = Length(Curve=intcrv_3.Curve)
data_11 = Data(z)
data_12 = Data(y)
division_5 = Division(A=len_5, B=data_12)
round_5 = Round(Number=division_5)  # -> Nearest, Floor, Ceiling
hframes_5 = HorizontalFrames(Curve=intcrv_3.Curve, Count=round_5.Floor)  # -> simplify(Frames), Parameters
divide_7 = DivideCurve(Curve=intcrv_3.Curve, Count=round_5.Floor, Kinks=False)  # -> Points, Tangents, Parameters
deplane_9 = DeconstructPlane(Plane=hframes_5.Frames)  # -> Origin, XAxis, simplify(YAxis), ZAxis
pl_5 = ConstructPlane(Origin=hframes_5.Frames, XAxis=deplane_9.YAxis, YAxis=divide_7.Tangents)
data_13 = Data(x)
dispatch_3 = Dispatch(List=pl_5, DispatchPattern=[True, False])  # -> ListA, ListB
deplane_10 = DeconstructPlane(Plane=dispatch_3.ListA)  # -> Origin, XAxis, simplify(YAxis), ZAxis
deplane_11 = DeconstructPlane(Plane=dispatch_3.ListB)  # -> Origin, XAxis, simplify(YAxis), ZAxis
rev_5 = Reverse(Vector=deplane_10.ZAxis)
box_5 = CenterBox(Base=dispatch_3.ListA, X=expr("X/2", data_13), Y=expr("X/2", data_12), Z=expr("X/2", data_11))
line_5 = LineSDL(Start=deplane_9.Origin, Direction=rev_5, Length=expr("X/2", data_11))
box_6 = CenterBox(Base=dispatch_3.ListB, X=expr("X/4", data_13), Y=expr("X/2", data_12), Z=data_11)
line_6 = LineSDL(Start=deplane_11.Origin, Direction=deplane_11.XAxis, Length=expr("X/4", data_13))
line_7 = LineSDL(Start=deplane_11.Origin, Direction=deplane_11.XAxis, Length=expr("X/2", data_13))
line_8 = LineSDL(Start=deplane_9.Origin, Direction=rev_5, Length=data_11)
move_5 = Move(Geometry=box_6, Motion=line_6)  # -> Geometry, Transform
rev_6 = Reverse(Vector=line_5)
move_6 = Move(Geometry=box_5, Motion=rev_6)  # -> Geometry, Transform
move_7 = Move(Geometry=move_6.Geometry, Motion=line_8)  # -> Geometry, Transform
rev_7 = Reverse(Vector=line_7)
move_8 = Move(Geometry=move_5.Geometry, Motion=rev_7)  # -> Geometry, Transform
data_14 = Data([move_6.Geometry, move_7.Geometry, move_5.Geometry, move_8.Geometry])

merge_2 = Merge(Data1=data_14, Data2=move_2.Geometry, Data3=cull_i_2, Data4=merge)

# ==== cluster Cluster
data = ClusterInput()
data_2 = ClusterInput()
data_3 = Data(data)
data_4 = Data(data_2)
item = ListItem(List=data_4, Index=3, Wrap=True)
item_2 = ListItem(List=data_4, Index=1, Wrap=True)
midpt = CurveMiddle(Curve=item)
midpt_2 = CurveMiddle(Curve=item_2)
scale = Scale(Geometry=item, Center=midpt, Factor=data_3)  # -> Geometry, Transform
scale_2 = Scale(Geometry=item_2, Center=midpt_2, Factor=data_3)  # -> Geometry, Transform
cp = ControlPoints(Curve=scale.Geometry)  # -> Points, Weights, Knots
cp_2 = ControlPoints(Curve=scale_2.Geometry)  # -> Points, Weights, Knots
item_3 = ListItem(List=cp_2.Points, Index=0, Wrap=True)  # -> Item, Item1
item_4 = ListItem(List=cp.Points, Index=0, Wrap=True)  # -> Item, Item1
srf4pt = _4PointSurface(CornerA=item_3.Item, CornerB=item_3.Item1, CornerC=item_4.Item, CornerD=item_4.Item1)
pshift = ShiftPaths(Data=srf4pt, Offset="-3")
D = ClusterOutput(pshift)
